# Grasshopper definition PanamaLaVieja.gh (Grasshopper 1.0.7)
# plug-ins: GHopperGIS

# ---- group: Input the file location
panel = Panel("C:\Users\Paula\Desktop\Felipe\Panama\Vieja.gpkg")

# ---- group: Construcciones / Field!
number_slider = Slider(24, range=0..24)  # disabled

# ---- group: WorldCenter
pt = ConstructPoint(XCoordinate=0, YCoordinate=0, ZCoordinate=0)

# ---- group: ScaleFactor
number_slider_2 = Slider(1000, range=0..1000)

# ---- group: Edificios
panel_2 = Panel("C:\Users\Paula\Desktop\Felipe\Panama\Edificios\EdificiosClipped.shp")
number_slider_3 = Slider(0, range=0..1)
gisextr = GISExtractor(PathToFile=panel_2, FieldToSelect=Slider(14, range=0..20), LayerToSelect=number_slider_3)  # -> CatchErrors, NumberOfFeatures, Layers, Fields, OutputField, GeometryType
gisext = GISExtents(PathToFile=panel_2, LayerToSelect=number_slider_3)  # -> CatchErrors, MinimumX, MinimumY, MaximumX, MaximumY
rdgis = ReadGIS(PathToFile=panel_2, ParallelComputation=Toggle(False), LayerToSelect=number_slider_3)  # -> CatchErrors, LatitudeOfGeometry, LongitudeOfGeometry, AltitudeOfGeometry, CullPattern
proj = Projections(Latitude=gisext.MinimumX, Longitude=gisext.MinimumY)  # -> ProjectedPoints, Erros
proj_2 = Projections(Latitude=gisext.MaximumX, Longitude=gisext.MaximumY)  # -> ProjectedPoints, Erros
proj_3 = Projections(Latitude=rdgis.LatitudeOfGeometry, Longitude=rdgis.LongitudeOfGeometry)  # -> ProjectedPoints, Erros
rec_2pt = Rectangle2Pt(Plane=PlaneXY(0, 0, 0), PointA=proj.ProjectedPoints, PointB=proj_2.ProjectedPoints, Radius=0)  # -> Rectangle, Length
area = Area(Geometry=rec_2pt.Rectangle)  # -> Area, Centroid
vec2pt = Vector2Pt(PointA=area.Centroid, PointB=pt, Unitize=False)  # -> Vector, Length
move = Move(Geometry=proj_3.ProjectedPoints, Motion=vec2pt.Vector)  # -> Geometry, Transform
number_slider_4 = Slider(10, range=0..10)
scale = Scale(Geometry=move.Geometry, Center=pt, Factor=number_slider_2)  # -> Geometry, Transform
pline = PolyLine(Vertices=scale.Geometry, Closed=False)

# ---- group: Rutas
panel_3 = Panel("C:\Users\Paula\Desktop\Felipe\Panama\RutasTransporte\RutasClipped.shp")
gisext_2 = GISExtents(PathToFile=panel_3, LayerToSelect=number_slider_3)  # -> CatchErrors, MinimumX, MinimumY, MaximumX, MaximumY
proj_4 = Projections(Latitude=gisext_2.MinimumX, Longitude=gisext_2.MinimumY)  # -> ProjectedPoints, Erros
proj_5 = Projections(Latitude=gisext_2.MaximumX, Longitude=gisext_2.MaximumY)  # -> ProjectedPoints, Erros
rdgis_2 = ReadGIS(PathToFile=panel_3, ParallelComputation=Toggle(False), LayerToSelect=Slider(0, range=0..5))  # -> CatchErrors, LatitudeOfGeometry, LongitudeOfGeometry, AltitudeOfGeometry, CullPattern
rec_2pt_2 = Rectangle2Pt(Plane=PlaneXY(0, 0, 0), PointA=proj_4.ProjectedPoints, PointB=proj_5.ProjectedPoints, Radius=0)  # -> Rectangle, Length
proj_6 = Projections(Latitude=rdgis_2.LatitudeOfGeometry, Longitude=rdgis_2.LongitudeOfGeometry)  # -> ProjectedPoints, Erros
area_2 = Area(Geometry=rec_2pt_2.Rectangle)  # -> Area, Centroid
vec2pt_2 = Vector2Pt(PointA=area_2.Centroid, PointB=pt, Unitize=False)  # -> Vector, Length
move_2 = Move(Geometry=proj_6.ProjectedPoints, Motion=vec2pt_2.Vector)  # -> Geometry, Transform
scale_2 = Scale(Geometry=move_2.Geometry, Center=pt, Factor=number_slider_2)  # -> Geometry, Transform
pline_2 = PolyLine(Vertices=scale_2.Geometry, Closed=False)

# ---- group: Barrios
panel_4 = Panel("C:\Users\Paula\Desktop\Felipe\Panama\Barrios\BarriosClipped.shp")
gisext_3 = GISExtents(PathToFile=panel_4, LayerToSelect=number_slider_3)  # -> CatchErrors, MinimumX, MinimumY, MaximumX, MaximumY
proj_7 = Projections(Latitude=gisext_3.MinimumX, Longitude=gisext_3.MinimumY)  # -> ProjectedPoints, Erros
proj_8 = Projections(Latitude=gisext_3.MaximumX, Longitude=gisext_3.MaximumY)  # -> ProjectedPoints, Erros
rdgis_3 = ReadGIS(PathToFile=panel_4, ParallelComputation=Toggle(False), LayerToSelect=Slider(0, range=0..5))  # -> CatchErrors, LatitudeOfGeometry, LongitudeOfGeometry, AltitudeOfGeometry, CullPattern
rec_2pt_3 = Rectangle2Pt(Plane=PlaneXY(0, 0, 0), PointA=proj_7.ProjectedPoints, PointB=proj_8.ProjectedPoints, Radius=0)  # -> Rectangle, Length
proj_9 = Projections(Latitude=rdgis_3.LatitudeOfGeometry, Longitude=rdgis_3.LongitudeOfGeometry)  # -> ProjectedPoints, Erros
area_3 = Area(Geometry=rec_2pt_3.Rectangle)  # -> Area, Centroid
vec2pt_3 = Vector2Pt(PointA=area_3.Centroid, PointB=pt, Unitize=False)  # -> Vector, Length
move_3 = Move(Geometry=proj_9.ProjectedPoints, Motion=vec2pt_3.Vector)  # -> Geometry, Transform
scale_3 = Scale(Geometry=move_3.Geometry, Center=pt, Factor=number_slider_2)  # -> Geometry, Transform
pline_3 = PolyLine(Vertices=scale_3.Geometry, Closed=False)

# ---- group: Parques
panel_5 = Panel("C:\Users\Paula\Desktop\Felipe\Panama\Park\ParkClipped.shp")
number_slider_5 = Slider(0, range=0..1)
gisextr_2 = GISExtractor(PathToFile=panel_5, FieldToSelect=Slider(5, range=0..10), LayerToSelect=number_slider_5)  # -> CatchErrors, NumberOfFeatures, Layers, Fields, OutputField, GeometryType
gisext_4 = GISExtents(PathToFile=panel_5, LayerToSelect=number_slider_5)  # -> CatchErrors, MinimumX, MinimumY, MaximumX, MaximumY
rdgis_4 = ReadGIS(PathToFile=panel_5, ParallelComputation=Toggle(True), LayerToSelect=number_slider_5)  # -> CatchErrors, LatitudeOfGeometry, LongitudeOfGeometry, AltitudeOfGeometry, CullPattern
proj_10 = Projections(Latitude=gisext_4.MinimumX, Longitude=gisext_4.MinimumY)  # -> ProjectedPoints, Erros
proj_11 = Projections(Latitude=gisext_4.MaximumX, Longitude=gisext_4.MaximumY)  # -> ProjectedPoints, Erros
proj_12 = Projections(Latitude=rdgis_4.LatitudeOfGeometry, Longitude=rdgis_4.LongitudeOfGeometry)  # -> ProjectedPoints, Erros
rec_2pt_4 = Rectangle2Pt(Plane=PlaneXY(0, 0, 0), PointA=proj_10.ProjectedPoints, PointB=proj_11.ProjectedPoints, Radius=0)  # -> Rectangle, Length
area_4 = Area(Geometry=rec_2pt_4.Rectangle)  # -> Area, Centroid
vec2pt_4 = Vector2Pt(PointA=area_4.Centroid, PointB=pt, Unitize=False)  # -> Vector, Length
move_4 = Move(Geometry=proj_12.ProjectedPoints, Motion=vec2pt_4.Vector)  # -> Geometry, Transform
scale_4 = Scale(Geometry=move_4.Geometry, Center=pt, Factor=number_slider_2)  # -> Geometry, Transform
tag = TextTag(Location=simplify(scale_4.Geometry), Text=simplify(graft(gisextr_2.OutputField)))
dots = DotDisplay(Point=scale_4.Geometry, Colour=RGB(0, 174, 0), Size=Slider(10, range=0..10))

# ----
panel_6 = Panel(gisextr.Fields)
panel_7 = Panel(gisextr.OutputField)

# ---- group: Vías
number_slider_6 = Slider(1, range=0..1)  # disabled
number_slider_7 = Slider(1, range=0..1)  # disabled
rdgis_5 = ReadGIS(PathToFile=panel, LayerToSelect=number_slider_7)  # -> CatchErrors, LatitudeOfGeometry, LongitudeOfGeometry, AltitudeOfGeometry, CullPattern; disabled
proj_13 = Projections(Latitude=rdgis_5.LatitudeOfGeometry, Longitude=rdgis_5.LongitudeOfGeometry)  # -> ProjectedPoints, Erros; disabled
pline_4 = PolyLine(Vertices=proj_13.ProjectedPoints, Closed=False)  # disabled

# ---- group: Vías / ExtractInfo
gisextr_3 = GISExtractor(PathToFile=panel, FieldToSelect=number_slider_6, LayerToSelect=number_slider_7)  # -> CatchErrors, NumberOfFeatures, Layers, Fields, OutputField, GeometryType; disabled
panel_8 = Panel(gisextr_3.OutputField)  # disabled

# ---- group: Construcciones
number_slider_8 = Slider(2, range=0..10)  # disabled
rdgis_6 = ReadGIS(PathToFile=panel, LayerToSelect=number_slider_8)  # -> CatchErrors, LatitudeOfGeometry, LongitudeOfGeometry, AltitudeOfGeometry, CullPattern; disabled
proj_14 = Projections(Latitude=rdgis_6.LatitudeOfGeometry, Longitude=rdgis_6.LongitudeOfGeometry)  # -> ProjectedPoints, Erros; disabled
pline_5 = PolyLine(Vertices=proj_14.ProjectedPoints, Closed=True)  # disabled

# ---- group: Construcciones / Extract Features
gisextr_4 = GISExtractor(PathToFile=panel, FieldToSelect=number_slider, LayerToSelect=number_slider_8)  # -> CatchErrors, NumberOfFeatures, Layers, Fields, OutputField, GeometryType; disabled
panel_9 = Panel(gisextr_4.OutputField)  # disabled

# ---- group: Construcciones / BBox
gisext_5 = GISExtents(PathToFile=panel, LayerToSelect=number_slider_8)  # -> CatchErrors, MinimumX, MinimumY, MaximumX, MaximumY; disabled
proj_15 = Projections(Latitude=gisext_5.MinimumX, Longitude=gisext_5.MinimumY)  # -> ProjectedPoints, Erros; disabled
proj_16 = Projections(Latitude=gisext_5.MaximumX, Longitude=gisext_5.MaximumY)  # -> ProjectedPoints, Erros; disabled
rec_2pt_5 = Rectangle2Pt(Plane=PlaneXY(0, 0, 0), PointA=proj_15.ProjectedPoints, PointB=proj_16.ProjectedPoints, Radius=0)  # -> Rectangle, Length; disabled
area_5 = Area(Geometry=rec_2pt_5.Rectangle)  # -> Area, Centroid; disabled
vec2pt_5 = Vector2Pt(PointA=area_5.Centroid, PointB=pt, Unitize=False)  # -> Vector, Length; disabled
move_5 = Move(Geometry=rec_2pt_5.Rectangle, Motion=vec2pt_5.Vector)  # -> Geometry, Transform; disabled
scale_5 = Scale(Geometry=move_5.Geometry, Center=pt, Factor=number_slider_2)  # -> Geometry, Transform; disabled

# ---- group: Vías / BBox
gisext_6 = GISExtents(PathToFile=panel, LayerToSelect=number_slider_8)  # -> CatchErrors, MinimumX, MinimumY, MaximumX, MaximumY; disabled
proj_17 = Projections(Latitude=gisext_6.MinimumX, Longitude=gisext_6.MinimumY)  # -> ProjectedPoints, Erros; disabled
proj_18 = Projections(Latitude=gisext_6.MaximumX, Longitude=gisext_6.MaximumY)  # -> ProjectedPoints, Erros; disabled
rec_2pt_6 = Rectangle2Pt(Plane=PlaneXY(0, 0, 0), PointA=proj_17.ProjectedPoints, PointB=proj_18.ProjectedPoints, Radius=0)  # -> Rectangle, Length; disabled
area_6 = Area(Geometry=rec_2pt_6.Rectangle)  # -> Area, Centroid; disabled

# ---- group: CenterY
subtraction = Subtraction(A=gisext_5.MaximumY, B=gisext_5.MinimumY)
multiplication = Multiplication(A=subtraction, B=0.5)
addition = Addition(A=gisext_5.MinimumY, B=multiplication)
panel_10 = Panel(addition)

# ---- group: CenterX
subtraction_2 = Subtraction(A=gisext_5.MaximumX, B=gisext_5.MinimumX)
multiplication_2 = Multiplication(A=subtraction_2, B=0.5)
addition_2 = Addition(A=gisext_5.MinimumX, B=multiplication_2)
panel_11 = Panel(addition_2)

# ---- group: Vías (continued)
vec2pt_6 = Vector2Pt(PointA=area_6.Centroid, PointB=pt, Unitize=False)  # -> Vector, Length; disabled
move_6 = Move(Geometry=pline_4, Motion=vec2pt_6.Vector)  # -> Geometry, Transform; disabled
scale_6 = Scale(Geometry=move_6.Geometry, Center=pt, Factor=number_slider_2)  # -> Geometry, Transform; disabled

# ---- group: Vías / NombreVías
expression = Expression(x=gisextr_3.OutputField, Expression="If( ( x ≠ \"\" ) and ( x ≠ \"This feature is null!\" ), True, False )")  # disabled
cull = CullPattern(List=flatten(scale_6.Geometry), CullPattern=expression)  # disabled
cull_2 = CullPattern(List=gisextr_3.OutputField, CullPattern=expression)  # disabled
eval = EvaluateCurve(Curve=reparameterize(cull), Parameter=0.5)  # -> Point, Tangent, Angle; disabled
tag_2 = TextTag(Location=eval.Point, Text=cull_2)  # disabled

# ---- group: Construcciones (continued)
move_7 = Move(Geometry=pline_5, Motion=vec2pt_5.Vector)  # -> Geometry, Transform; disabled
scale_7 = Scale(Geometry=move_7.Geometry, Center=pt, Factor=number_slider_2)  # -> Geometry, Transform; disabled

# ---- group: Construcciones / Extrusiones
number_slider_9 = Slider(10000, range=0..10000)  # disabled
area_7 = Area(Geometry=scale_7.Geometry)  # -> Area, Centroid; disabled
expression_2 = Expression(x=flatten(area_7.Area), y=number_slider_9, Expression="If( x < y, True, False )")  # disabled
number_slider_10 = Slider(3, range=0..10)  # disabled
cull_3 = CullPattern(List=flatten(scale_7.Geometry), CullPattern=expression_2)  # disabled
boundary = BoundarySurfaces(Edges=cull_3, UseTasks=False)  # disabled
Z = UnitZ(Factor=number_slider_10)  # disabled
extr = Extrude(Base=boundary, Direction=Z)  # disabled
